# Grasshopper definition CMYK_image_sampling_3.gh (Grasshopper 0.9.56)

inner_offset = Slider(4, range=1..32)
outer_offset = Slider(8, range=1..32)
grid_spacing = Slider(1, range=0.25..5)
image_size_x = Number(44)
image_size_y = Number(64)
offset = Number(0)

rectangular = Rectangular(Plane=PlaneXY(0, 0, 0), SizeX=grid_spacing, SizeY=grid_spacing, ExtentX=image_size_x, ExtentY=image_size_y)  # -> Cells, Points
relative_item = RelativeItem(Tree=rectangular.Points, Offset="{0;0;1}(1)", WrapPaths=False, WrapItems=False)  # -> ItemA, ItemB
polygon_center = PolygonCenter(Polyline=rectangular.Cells)  # -> CenterV, CenterE
line = Line(StartPoint=relative_item.ItemA, EndPoint=relative_item.ItemB)
remap_numbers = RemapNumbers(Value=<missing>, Source=Domain(0, 1), Target=Domain(1, 0))
flatten_tree = FlattenTree(Tree=remap_numbers, Path="{0}")
average = Average(Input=flatten_tree)
larger_than = LargerThan(FirstNumber=remap_numbers, SecondNumber=average)  # -> LargerThan, OrEqualTo
dispatch = Dispatch(List=remap_numbers, DispatchPattern=larger_than.LargerThan)  # -> LargerThan, LessThan
subtraction = Subtraction(A=dispatch.LessThan, B=offset)
addition = Addition(A=dispatch.LargerThan, B=offset)
maximum = Maximum(A=subtraction, B=0.001)
minimum = Minimum(A=addition, B=1)
merge = Merge(Data1=minimum, Data2=maximum)
scale = Scale(Geometry=line, Center=polygon_center.CenterV, Factor=merge)  # -> Geometry, Transform
division = Division(A=grid_spacing, B=inner_offset)
multiplication = Multiplication(A=division, B=-1)
offset_2 = Offset(Curve=scale.Geometry, Distance=multiplication, Plane=PlaneXY(0, 0, 0), Corners=1)

rectangular_2 = Rectangular(Plane=PlaneXY(0, 0, 0), SizeX=grid_spacing, SizeY=grid_spacing, ExtentX=image_size_x, ExtentY=image_size_y)  # -> Cells, Points
relative_item_2 = RelativeItem(Tree=rectangular_2.Points, Offset="{0;0;1}(1)", WrapPaths=False, WrapItems=False)  # -> ItemA, ItemB
polygon_center_2 = PolygonCenter(Polyline=rectangular_2.Cells)  # -> CenterV, CenterE
line_2 = Line(StartPoint=relative_item_2.ItemA, EndPoint=relative_item_2.ItemB)
remap_numbers_2 = RemapNumbers(Value=<missing>, Source=Domain(0, 1), Target=Domain(1, 0))
flatten_tree_2 = FlattenTree(Tree=remap_numbers_2, Path="{0}")
average_2 = Average(Input=flatten_tree_2)
larger_than_2 = LargerThan(FirstNumber=remap_numbers_2, SecondNumber=average_2)  # -> LargerThan, OrEqualTo
dispatch_2 = Dispatch(List=remap_numbers_2, DispatchPattern=larger_than_2.LargerThan)  # -> LargerThan, LessThan
subtraction_2 = Subtraction(A=dispatch_2.LessThan, B=offset)
addition_2 = Addition(A=dispatch_2.LargerThan, B=offset)
minimum_2 = Minimum(A=addition_2, B=1)
maximum_2 = Maximum(A=subtraction_2, B=0.001)
merge_2 = Merge(Data1=minimum_2, Data2=maximum_2)
scale_2 = Scale(Geometry=line_2, Center=polygon_center_2.CenterV, Factor=merge_2)  # -> Geometry, Transform
division_2 = Division(A=grid_spacing, B=outer_offset)
offset_3 = Offset(Curve=scale_2.Geometry, Distance=division_2, Plane=PlaneXY(0, 0, 0), Corners=1)

rectangular_3 = Rectangular(Plane=PlaneXY(0, 0, 0), SizeX=grid_spacing, SizeY=grid_spacing, ExtentX=image_size_x, ExtentY=image_size_y)  # -> Cells, Points
relative_item_3 = RelativeItem(Tree=rectangular_3.Points, Offset="{0;0;1}(1)", WrapPaths=False, WrapItems=False)  # -> ItemA, ItemB
polygon_center_3 = PolygonCenter(Polyline=rectangular_3.Cells)  # -> CenterV, CenterE
line_3 = Line(StartPoint=relative_item_3.ItemA, EndPoint=relative_item_3.ItemB)
remap_numbers_3 = RemapNumbers(Value=<missing>, Source=Domain(0, 1), Target=Domain(1, 0))
flatten_tree_3 = FlattenTree(Tree=remap_numbers_3, Path="{0}")
average_3 = Average(Input=flatten_tree_3)
larger_than_3 = LargerThan(FirstNumber=remap_numbers_3, SecondNumber=average_3)  # -> LargerThan, OrEqualTo
dispatch_3 = Dispatch(List=remap_numbers_3, DispatchPattern=larger_than_3.LargerThan)  # -> LargerThan, LessThan
subtraction_3 = Subtraction(A=dispatch_3.LessThan, B=offset)
addition_3 = Addition(A=dispatch_3.LargerThan, B=offset)
maximum_3 = Maximum(A=subtraction_3, B=0.001)
minimum_3 = Minimum(A=addition_3, B=1)
merge_3 = Merge(Data1=minimum_3, Data2=maximum_3)
scale_3 = Scale(Geometry=line_3, Center=polygon_center_3.CenterV, Factor=merge_3)  # -> Geometry, Transform
division_3 = Division(A=grid_spacing, B=outer_offset)
multiplication_2 = Multiplication(A=division_3, B=-1)
offset_4 = Offset(Curve=scale_3.Geometry, Distance=multiplication_2, Plane=PlaneXY(0, 0, 0), Corners=1)

rectangular_4 = Rectangular(Plane=PlaneXY(0, 0, 0), SizeX=grid_spacing, SizeY=grid_spacing, ExtentX=image_size_x, ExtentY=image_size_y)  # -> Cells, Points
relative_item_4 = RelativeItem(Tree=rectangular_4.Points, Offset="{0;0;1}(1)", WrapPaths=False, WrapItems=False)  # -> ItemA, ItemB
polygon_center_4 = PolygonCenter(Polyline=rectangular_4.Cells)  # -> CenterV, CenterE
remap_numbers_4 = RemapNumbers(Value=<missing>, Source=Domain(0, 1), Target=Domain(1, 0))
flatten_tree_4 = FlattenTree(Tree=remap_numbers_4, Path="{0}")
line_4 = Line(StartPoint=relative_item_4.ItemA, EndPoint=relative_item_4.ItemB)
average_4 = Average(Input=flatten_tree_4)
larger_than_4 = LargerThan(FirstNumber=remap_numbers_4, SecondNumber=average_4)  # -> LargerThan, OrEqualTo
dispatch_4 = Dispatch(List=remap_numbers_4, DispatchPattern=larger_than_4.LargerThan)  # -> LargerThan, LessThan
subtraction_4 = Subtraction(A=dispatch_4.LessThan, B=offset)
addition_4 = Addition(A=dispatch_4.LargerThan, B=offset)
maximum_4 = Maximum(A=subtraction_4, B=0.001)
minimum_4 = Minimum(A=addition_4, B=1)
merge_4 = Merge(Data1=minimum_4, Data2=maximum_4)
scale_4 = Scale(Geometry=line_4, Center=polygon_center_4.CenterV, Factor=merge_4)  # -> Geometry, Transform
division_4 = Division(A=grid_spacing, B=inner_offset)
offset_5 = Offset(Curve=scale_4.Geometry, Distance=division_4, Plane=PlaneXY(0, 0, 0), Corners=1)

join_curves = JoinCurves(Curves=offset_4, Preserve=False)
join_curves_2 = JoinCurves(Curves=offset_2, Preserve=False)
join_curves_3 = JoinCurves(Curves=offset_3, Preserve=False)
join_curves_4 = JoinCurves(Curves=offset_5, Preserve=False)
custom_preview = CustomPreview(
    Geometry=join_curves,
    Shader={diffuse=RGB(255, 255, 0), ambient=RGB(128, 128, 128), emission=RGB(76, 32, 54), specular=RGB(255, 255, 255), shine=0.5, transparency=0})
custom_preview_2 = CustomPreview(
    Geometry=join_curves_2,
    Shader={diffuse=RGB(0, 0, 0), ambient=RGB(128, 128, 128), emission=RGB(76, 32, 54), specular=RGB(255, 255, 255), shine=0.5, transparency=0})
custom_preview_3 = CustomPreview(
    Geometry=join_curves_3,
    Shader={diffuse=RGB(255, 0, 255), ambient=RGB(128, 128, 128), emission=RGB(76, 32, 54), specular=RGB(255, 255, 255), shine=0.5, transparency=0})
custom_preview_4 = CustomPreview(
    Geometry=join_curves_4,
    Shader={diffuse=RGB(0, 255, 255), ambient=RGB(128, 128, 128), emission=RGB(76, 32, 54), specular=RGB(255, 255, 255), shine=0.5, transparency=0})
